# Grasshopper definition 4_AnnualWindAnalysis.ghx (Grasshopper 1.0.7)
# plug-ins: Eddy3D

panel = Panel("C:\Users\pkastner\Google Drive\Patrick\Papers\CPGenerator\Conference\Data\Weather\AUS_NSW.Dubbo.Airport.957190_RMY.epw")

# ----
# 1. Geometry &
# Boundary Conditions
# C:\DIVA\WeatherData\USA_IL_Chicago-OHare.Intl.AP.725300_TMY3.epw
panel_2 = Panel("""0
45
90
135
180
225
270
315""")
abl = ABL(WDir=panel_2, Uref="10", Zref=10, Z0=1, ZGround=0, Epw=panel)
geo = Geometry([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])

# ----
# 2. Simulation Domain
number_slider = Slider(50, range=0..1000)
domaincyl = CylindricalDomain(
    Geometry=geo,
    BCond=abl,
    BlockSize="10",
    SizeOfInnerRectangle=number_slider,
    SizeOfOuterRadius=Slider(300, range=0..1000),
    Height=Slider(80, range=0..1000))  # -> Domain, Mesh

cellsize = CellSize(SimulationDomain=domaincyl.Domain, BlockSize="10", DesiredCellSize=Slider(5, range=0..10))
c_script = CSharpScript(
    URefEPW=Slider(10, range=0..10),
    probingHeight=Slider(1, range=0..20),
    zref=Slider(10, range=0..10),
    z0=Slider(1, range=0..10))  # -> out, A; inputs URefEPW: Double, probingHeight: Double, zref: Double, z0: Double
# ---------- c_script: C# ----------
  
  

A =  ((0.41 * URefEPW) / Math.Log((zref + z0) / z0) / 0.41) * Math.Log((probingHeight + z0) / z0);
# ---------- end c_script ----------
utci = UTCI(
    AmbientTemperature=Slider(0, range=0..100),
    MeanRadiantTemperature=Slider(8, range=0..100),
    WindVelocity=Slider(0, range=0..100),
    RelativeHumidity=Slider(0, range=0..100))
panel_3 = Panel(c_script.A)
panel_4 = Panel(utci)

# ----
# 3. Mesh & Simulation
panel_5 = Panel("C:\test_cyl")
mset = MeshSettings(AccBuilding=2, AccFeatures="2", AccRefinement=0, AccGround=2, NLayer=3, Mode=1)

rset = RunSettings(
    NumberOfIterations="40",
    WriteInterval=20,
    NumberOfTimestepsToKeep=3,
    TurbulenceModel=1,
    RelaxationFactors=1,
    SolutionAndAlgorithmControl=0,
    PotentialFoamInitialization=False,
    NumberOfCPUs="-1",
    OperatingSystem=0)

simulation = Simulation(
    SimulationDomain=domaincyl.Domain,
    WorkingDirectory=panel_5,
    MeshSettings=mset,
    RunSettings=rset,
    RunMeshing=Button(),
    RunSimulation=Button(),
    runWithBlueCFD=True)

residuals = Residuals(Result=simulation, SelectionOfWindDirections="0", X=":", Y=":", Version=0, Run=Button(), visResiduals=False)

# ----
# 4. Probing points & probing
number_slider_2 = Slider(15, range=1..50)
brep = Brep(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)
meshplane = MeshPlane(brep=brep, number=number_slider_2)  # -> vertices, faces
visprobes = VisualizeProbes(Result=simulation, ProbingPoints=meshplane.vertices, NameOfInstance="cyl", NameOfField=0, Run=Button(), Culling=True)  # -> PorbingPoints, ProbingResult

# ----
# 6. Clean
button = Button()
clean = Clean(Directory=panel_5, Mode=2, Run=button)

# ----
# 5. Post-processing
# 5.1. Paraview
# Multi-directional / annual wind vectors
# 5.2. Grasshopper
# 5.3. Grasshopper
# Pedestrian wind comfort (wind reduction factors)
# Pedestrian wind comfort (NEN8100)
button_2 = Button()
dir = Slider(2, range=0..7)
vectors = Data(visprobes.ProbingResult)
points = Data(visprobes.PorbingPoints)
paraview = Paraview(Result=simulation, ParaviewVersion=2, Run=button_2)
choose_dir = TreeBranch(Tree=vectors, Path=dir, MaintainPaths=True)
Y = UnitY(Factor="200")
cluster = Cluster(data=choose_dir)  # -> S, E, data_3
move = Move(Geometry=geo, Motion=Y)  # -> Geometry, Transform
cluster_2 = Cluster_3(C=points, T=Y)
gradient = Gradient(
    LowerLimit=cluster.S,
    UpperLimit=Slider(6, range=0..10),
    Parameter=cluster.data_3,
    stops=[0.103: RGB(0, 0, 255), 0.22: RGB(0, 170, 255), 0.305: RGB(0, 255, 255), 0.398: RGB(0, 255, 188), 0.504: RGB(0, 255, 106), 0.605: RGB(91, 255, 0), 0.699: RGB(184, 255, 0), 0.799: RGB(255, 255, 0), 0.898: RGB(255, 170, 0)])
vdisex = VectorDisplayEx(Point=points, Vector=choose_dir, Colour=gradient, Width=Slider(3, range=0..10))  # disabled
cluster_3 = Cluster_2(C=points)

pedestrian_comfort = PedestrianComfort(Result=simulation, ProbingPoints=points, WindVelocity=vectors, ComfortIndex=4, Run=Button(), Interpolation=False)  # -> WindReductionFactors, PedestrianWindComfort, OffSet

dedata = DeconstructData(Data=pedestrian_comfort.WindReductionFactors)
cluster_4 = Cluster(data=pedestrian_comfort.PedestrianWindComfort)  # -> S, E, data_3
flip = FlipMatrix(Data=dedata)
gradient_2 = Gradient(
    LowerLimit=cluster_4.S,
    UpperLimit=cluster_4.E,
    Parameter=cluster_4.data_3,
    stops=[0.103: RGB(0, 0, 255), 0.22: RGB(0, 170, 255), 0.305: RGB(0, 255, 255), 0.398: RGB(0, 255, 188), 0.504: RGB(0, 255, 106), 0.605: RGB(91, 255, 0), 0.699: RGB(184, 255, 0), 0.799: RGB(255, 255, 0), 0.898: RGB(255, 170, 0)])
avr = Average(Input=flip)  # -> flatten(ArithmeticMean)
cluster_5 = Cluster(data=avr)  # -> S, E, data_3
gradient_3 = Gradient(
    LowerLimit=cluster_5.S,
    UpperLimit=cluster_5.E,
    Parameter=cluster_5.data_3,
    stops=[0.103: RGB(0, 0, 255), 0.22: RGB(0, 170, 255), 0.305: RGB(0, 255, 255), 0.398: RGB(0, 255, 188), 0.504: RGB(0, 255, 106), 0.605: RGB(91, 255, 0), 0.699: RGB(184, 255, 0), 0.799: RGB(255, 255, 0), 0.898: RGB(255, 170, 0)])
preview = CustomPreview(Geometry=cluster_2, Material=gradient_2)
preview_2 = CustomPreview(Geometry=cluster_3, Material=gradient_3)

# ==== cluster MeshPlane
number = ClusterInput()
number_2 = Number(number)
settings_custom = SettingsCustom(
    StitchSeams=True,
    SimplePlanes=False,
    Refine=True,
    MinCount=16,
    MaxCount=400,
    AspectRatio=20,
    MaxDistance=0,
    MaxAngle=20,
    MinEdge=number_2,
    MaxEdge=number_2)
brep = ClusterInput()
mesh_brep = MeshBrep(Brep=brep, Settings=settings_custom)
deconstruct_mesh = DeconstructMesh(Mesh=mesh_brep)  # -> Vertices, Faces, Colours, Normals
faces = ClusterOutput(deconstruct_mesh.Faces)
vertices = ClusterOutput(deconstruct_mesh.Vertices)

# ==== cluster Cluster
data = ClusterInput()
data_2 = Data(data)
data_3 = ClusterOutput(data_2)
bnd = Bounds(Numbers=data_2)
dedomain = DeconstructDomain(Domain=bnd)  # -> Start, End
S = ClusterOutput(dedomain.Start)
E = ClusterOutput(dedomain.End)

# ==== cluster Cluster_2
C = ClusterInput()
circle = CircleCNR(Center=C, Normal=Vector(0, 0, 1), Radius=2)
srf = Surface(circle)
srf_2 = ClusterOutput(srf)

# ==== cluster Cluster_3
C = ClusterInput()
T = ClusterInput()
cluster = Cluster_2(C=C)
move = Move(Geometry=cluster, Motion=T)  # -> Geometry, Transform
G = ClusterOutput(move.Geometry)
